# Grasshopper definition morph_test.gh (Grasshopper 0.9.76)

number_slider = Slider(0.211, range=0..1)
radius = Slider(0.43, range=0..2)
X = UnitX(Factor=1)
vec = VectorXYZ(XComponent=0, YComponent=0, ZComponent=number_slider)  # -> Vector, Length
vec_2 = VectorXYZ(XComponent=0, YComponent=0, ZComponent=number_slider)  # -> Vector, Length
number_slider_2 = Slider(-0.198, range=-1..0)
vec_3 = Vector(vec.Vector)
circle = CircleCNR(Center=Point(0, 0, 0), Normal=X, Radius=radius)
ins = InsertItems(List=vec_3, Item=vec_2.Vector, Indices=1, Wrap=True)
ins_2 = InsertItems(List=ins, Item=vec_2.Vector, Indices=2, Wrap=True)
vec_4 = VectorXYZ(XComponent=0, YComponent=0, ZComponent=number_slider_2)  # -> Vector, Length
vec_5 = VectorXYZ(XComponent=0, YComponent=0, ZComponent=number_slider_2)  # -> Vector, Length
cpoly = ControlPolygon(Curve=circle)  # -> Polygon, Points
series = Series(Start=5, Step=1, Count=3)
vec_6 = Vector(vec_4.Vector)
item = ListItem(List=cpoly.Points, Index=series, Wrap=True)
ins_3 = InsertItems(List=vec_6, Item=vec_5.Vector, Indices=1, Wrap=True)
series_2 = Series(Start=1, Step=1, Count=3)
ins_4 = InsertItems(List=ins_3, Item=vec_5.Vector, Indices=2, Wrap=True)
item_2 = ListItem(List=cpoly.Points, Index=series_2, Wrap=True)
pt = Point(cpoly.Points)
int = Integer([1, 7, 5, 3])
item_3 = ListItem(List=pt, Index=int, Wrap=True)
item_4 = ListItem(List=item_3, Index=0, Wrap=True)
item_5 = ListItem(List=item_3, Index=1, Wrap=True)
item_6 = ListItem(List=item_3, Index=2, Wrap=True)
item_7 = ListItem(List=item_3, Index=3, Wrap=True)
srf4pt = _4PointSurface(CornerA=item_4, CornerB=item_5, CornerC=item_6, CornerD=item_7)
bottom = PointDeform(Geometry=circle, Points=item, Motion=ins_2)
X_2 = UnitX(Factor=Slider(-0.537, range=-1..0))
X_3 = UnitX(Factor=Slider(0.515, range=0..1))
arrlinear = LinearArray(Geometry=srf4pt, Direction=X_2, Count=6)  # -> Geometry, Transform
arrlinear_2 = LinearArray(Geometry=srf4pt, Direction=X_3, Count=3)  # -> Geometry, Transform
top = PointDeform(Geometry=bottom, Points=item_2, Motion=ins_4)
item_8 = ListItem(List=arrlinear_2.Geometry, Index=1, Wrap=True)
item_9 = ListItem(List=arrlinear_2.Geometry, Index=2, Wrap=True)
amoments = AreaMoments(Geometry=top)  # -> Area, Centroid, Inertia, InertiaError, Secondary, SecondaryError, Gyration
item_10 = ListItem(List=arrlinear.Geometry, Index=1, Wrap=True)
item_11 = ListItem(List=arrlinear.Geometry, Index=2, Wrap=True)
item_12 = ListItem(List=arrlinear.Geometry, Index=3, Wrap=True)
item_13 = ListItem(List=arrlinear.Geometry, Index=4, Wrap=True)
item_14 = ListItem(List=arrlinear.Geometry, Index=5, Wrap=True)
project = Project(Geometry=top, Plane=item_8)  # -> Geometry, Transform
project_2 = Project(Geometry=top, Plane=item_9)  # -> Geometry, Transform
number_slider_3 = Slider(0.9, range=0..2)
number_slider_4 = Slider(0.658, range=0..2)
amoments_2 = AreaMoments(Geometry=project.Geometry)  # -> Area, Centroid, Inertia, InertiaError, Secondary, SecondaryError, Gyration
amoments_3 = AreaMoments(Geometry=project_2.Geometry)  # -> Area, Centroid, Inertia, InertiaError, Secondary, SecondaryError, Gyration
project_3 = Project(Geometry=top, Plane=item_10)  # -> Geometry, Transform
project_4 = Project(Geometry=top, Plane=item_11)  # -> Geometry, Transform
project_5 = Project(Geometry=top, Plane=item_12)  # -> Geometry, Transform
project_6 = Project(Geometry=top, Plane=item_13)  # -> Geometry, Transform
project_7 = Project(Geometry=top, Plane=item_14)  # -> Geometry, Transform
graph = GraphMapper(
    number_slider_3,
    x0=0,
    x1=2,
    y0=0,
    y1=2,
    container_name="Bezier",
    cpx=[0, 0.2449278831, 0.6608692408, 1],
    cpy=[0.8967391253, 0.8507245779, 0.7608695626, 0.4188404679])
graph_2 = GraphMapper(
    number_slider_4,
    x0=0,
    x1=2,
    y0=0,
    y1=2,
    container_name="Bezier",
    cpx=[0, 0.2449278831, 0.6608692408, 1],
    cpy=[0.8967391253, 0.8507245779, 0.7608695626, 0.4188404679])
amoments_4 = AreaMoments(Geometry=project_3.Geometry)  # -> Area, Centroid, Inertia, InertiaError, Secondary, SecondaryError, Gyration
number_slider_5 = Slider(0.17, range=0..2)
amoments_5 = AreaMoments(Geometry=project_7.Geometry)  # -> Area, Centroid, Inertia, InertiaError, Secondary, SecondaryError, Gyration
amoments_6 = AreaMoments(Geometry=project_6.Geometry)  # -> Area, Centroid, Inertia, InertiaError, Secondary, SecondaryError, Gyration
amoments_7 = AreaMoments(Geometry=project_5.Geometry)  # -> Area, Centroid, Inertia, InertiaError, Secondary, SecondaryError, Gyration
amoments_8 = AreaMoments(Geometry=project_4.Geometry)  # -> Area, Centroid, Inertia, InertiaError, Secondary, SecondaryError, Gyration
number_slider_6 = Slider(0.32, range=0..1)
graph_3 = GraphMapper(
    Slider(0, range=0..1),
    x0=0,
    x1=1,
    y0=0,
    y1=1,
    container_name="Bezier",
    cpx=[0, 0.2449278831, 0.6608692408, 1],
    cpy=[0.8967391253, 0.8507245779, 0.7608695626, 0.4188404679])
graph_4 = GraphMapper(
    Slider(0.58, range=0..1),
    x0=0,
    x1=1,
    y0=0,
    y1=1,
    container_name="Bezier",
    cpx=[0, 0.2449278831, 0.6608692408, 1],
    cpy=[0.8967391253, 0.8507245779, 0.7608695626, 0.4188404679])
graph_5 = GraphMapper(
    Slider(0.87, range=0..1),
    x0=0,
    x1=1,
    y0=0,
    y1=1,
    container_name="Bezier",
    cpx=[0, 0.2449278831, 0.6608692408, 1],
    cpy=[0.8967391253, 0.8507245779, 0.7608695626, 0.4188404679])
graph_6 = GraphMapper(
    number_slider_6,
    x0=0,
    x1=1,
    y0=0,
    y1=1,
    container_name="Bezier",
    cpx=[0, 0.2449278831, 0.6608692408, 1],
    cpy=[0.8967391253, 0.8507245779, 0.7608695626, 0.4188404679])
graph_7 = GraphMapper(
    number_slider_5,
    x0=0,
    x1=2,
    y0=0,
    y1=2,
    container_name="Bezier",
    cpx=[0, 0.2449278831, 0.6608692408, 1],
    cpy=[0.8967391253, 0.8507245779, 0.7608695626, 0.4188404679])
scale = Scale(Geometry=project_3.Geometry, Center=amoments_4.Centroid, Factor=graph_3)  # -> Geometry, Transform
scale_2 = Scale(Geometry=project_4.Geometry, Center=amoments_8.Centroid, Factor=graph_4)  # -> Geometry, Transform
scale_3 = Scale(Geometry=project_5.Geometry, Center=amoments_7.Centroid, Factor=graph_5)  # -> Geometry, Transform
scale_4 = Scale(Geometry=project_6.Geometry, Center=amoments_6.Centroid, Factor=number_slider_6)  # -> Geometry, Transform
scale_5 = Scale(Geometry=project_7.Geometry, Center=amoments_5.Centroid, Factor=number_slider_5)  # -> Geometry, Transform
crv = Curve(scale.Geometry)
scale_6 = Scale(Geometry=project.Geometry, Center=amoments_2.Centroid, Factor=number_slider_3)  # -> Geometry, Transform
scale_7 = Scale(Geometry=project_2.Geometry, Center=amoments_3.Centroid, Factor=number_slider_4)  # -> Geometry, Transform
ins_5 = InsertItems(List=crv, Item=scale_2.Geometry, Indices=1, Wrap=True)
ins_6 = InsertItems(List=ins_5, Item=scale_3.Geometry, Indices=2, Wrap=True)
ins_7 = InsertItems(List=ins_6, Item=scale_4.Geometry, Indices=3, Wrap=True)
ins_8 = InsertItems(List=ins_7, Item=scale_5.Geometry, Indices=4, Wrap=True)
ins_9 = InsertItems(List=ins_8, Item=top, Indices=5, Wrap=True)
ins_10 = InsertItems(List=ins_9, Item=scale_6.Geometry, Indices=6, Wrap=True)
ins_11 = InsertItems(List=ins_10, Item=scale_7.Geometry, Indices=7, Wrap=True)
loft = Loft(Curves=ins_11, Options={Adjust=False, Closed=False, LoftEnds=0, LoftSimp=0, LoftType=0, Rebuild=10, Refit=0.01})
