# Grasshopper definition surface_morph.gh (Grasshopper 0.9.76)
# plug-ins: Octopus, goat

hull = Surface(<surface referenced from the Rhino model>)

srfpt = SurfacePoints(Surface=hull)  # -> Points, Weights, Greville, UCount, VCount
item = ListItem(List=srfpt.Points, Index=Slider(0, range=0..36), Wrap=True)
controlpoints = Point(item)
item_2 = ListItem(List=srfpt.Points, Index=Slider(1, range=0..36), Wrap=True)
item_3 = ListItem(List=srfpt.Points, Index=Slider(6, range=0..36), Wrap=True)
item_4 = ListItem(List=srfpt.Points, Index=Slider(7, range=0..36), Wrap=True)
item_5 = ListItem(List=srfpt.Points, Index=Slider(12, range=0..36), Wrap=True)
item_6 = ListItem(List=srfpt.Points, Index=Slider(13, range=0..36), Wrap=True)
item_7 = ListItem(List=srfpt.Points, Index=Slider(18, range=0..36), Wrap=True)
item_8 = ListItem(List=srfpt.Points, Index=Slider(19, range=0..36), Wrap=True)
item_9 = ListItem(List=srfpt.Points, Index=Slider(24, range=0..36), Wrap=True)
item_10 = ListItem(List=srfpt.Points, Index=Slider(25, range=0..36), Wrap=True)
item_11 = ListItem(List=srfpt.Points, Index=Slider(30, range=0..36), Wrap=True)
ins = InsertItems(List=controlpoints, Item=item_2, Indices=0, Wrap=True)
ins_2 = InsertItems(List=ins, Item=item_3, Indices=1, Wrap=True)
ins_3 = InsertItems(List=ins_2, Item=item_4, Indices=2, Wrap=True)
ins_4 = InsertItems(List=ins_3, Item=item_5, Indices=3, Wrap=True)
ins_5 = InsertItems(List=ins_4, Item=item_6, Indices=4, Wrap=True)
ins_6 = InsertItems(List=ins_5, Item=item_7, Indices=5, Wrap=True)
ins_7 = InsertItems(List=ins_6, Item=item_8, Indices=6, Wrap=True)
ins_8 = InsertItems(List=ins_7, Item=item_9, Indices=7, Wrap=True)
ins_9 = InsertItems(List=ins_8, Item=item_9, Indices=8, Wrap=True)
ins_10 = InsertItems(List=ins_9, Item=item_10, Indices=8, Wrap=True)
ins_11 = InsertItems(List=ins_10, Item=item_11, Indices=8, Wrap=True)

area = Area(Geometry=hull)  # -> Area, Centroid

number_slider = Slider(0, range=-1..1)
number_slider_2 = Slider(0, range=-1..1)
number_slider_3 = Slider(0, range=-1..1)
number_slider_4 = Slider(0, range=-1..1)
number_slider_5 = Slider(0, range=-1..1)
number_slider_6 = Slider(0, range=-1..1)
number_slider_7 = Slider(0, range=-1..1)
number_slider_8 = Slider(0, range=-1..1)
number_slider_9 = Slider(0, range=-1..1)
number_slider_10 = Slider(0, range=-1..1)
number_slider_11 = Slider(0, range=-1..1)
number_slider_12 = Slider(0, range=-1..1)
number_slider_13 = Slider(0, range=-1..1)
number_slider_14 = Slider(0, range=-1..1)
number_slider_15 = Slider(0, range=-1..1)
number_slider_16 = Slider(0, range=-1..1)
number_slider_17 = Slider(0, range=-1..1)
number_slider_18 = Slider(0, range=-1..1)
number_slider_19 = Slider(0, range=-1..1)
number_slider_20 = Slider(0, range=-1..1)
number_slider_21 = Slider(0, range=-1..1)
number_slider_22 = Slider(0, range=-1..1)
number_slider_23 = Slider(0, range=-1..1)
number_slider_24 = Slider(0, range=-1..1)
vec = VectorXYZ(XComponent=0, YComponent=number_slider, ZComponent=number_slider_2)  # -> Vector, Length
vec_2 = VectorXYZ(XComponent=0, YComponent=number_slider_3, ZComponent=number_slider_4)  # -> Vector, Length
vec_3 = VectorXYZ(XComponent=0, YComponent=number_slider_5, ZComponent=number_slider_6)  # -> Vector, Length
vec_4 = VectorXYZ(XComponent=0, YComponent=number_slider_7, ZComponent=number_slider_8)  # -> Vector, Length
vec_5 = VectorXYZ(XComponent=0, YComponent=number_slider_9, ZComponent=number_slider_10)  # -> Vector, Length
vec_6 = VectorXYZ(XComponent=0, YComponent=number_slider_11, ZComponent=number_slider_12)  # -> Vector, Length
vec_7 = VectorXYZ(XComponent=0, YComponent=number_slider_13, ZComponent=number_slider_14)  # -> Vector, Length
vec_8 = VectorXYZ(XComponent=0, YComponent=number_slider_15, ZComponent=number_slider_16)  # -> Vector, Length
vec_9 = VectorXYZ(XComponent=0, YComponent=number_slider_17, ZComponent=number_slider_18)  # -> Vector, Length
vec_10 = VectorXYZ(XComponent=0, YComponent=number_slider_19, ZComponent=number_slider_20)  # -> Vector, Length
vec_11 = VectorXYZ(XComponent=0, YComponent=number_slider_21, ZComponent=number_slider_22)  # -> Vector, Length
vec_12 = VectorXYZ(XComponent=0, YComponent=number_slider_23, ZComponent=number_slider_24)  # -> Vector, Length
vec_13 = Vector(vec.Vector)
ins_12 = InsertItems(List=vec_13, Item=vec_2.Vector, Indices=1, Wrap=True)
ins_13 = InsertItems(List=ins_12, Item=vec_3.Vector, Indices=2, Wrap=True)
ins_14 = InsertItems(List=ins_13, Item=vec_4.Vector, Indices=3, Wrap=True)
ins_15 = InsertItems(List=ins_14, Item=vec_5.Vector, Indices=4, Wrap=True)
ins_16 = InsertItems(List=ins_15, Item=vec_6.Vector, Indices=5, Wrap=True)
ins_17 = InsertItems(List=ins_16, Item=vec_7.Vector, Indices=6, Wrap=True)
ins_18 = InsertItems(List=ins_17, Item=vec_8.Vector, Indices=7, Wrap=True)
ins_19 = InsertItems(List=ins_18, Item=vec_9.Vector, Indices=8, Wrap=True)
ins_20 = InsertItems(List=ins_19, Item=vec_10.Vector, Indices=9, Wrap=True)
ins_21 = InsertItems(List=ins_20, Item=vec_11.Vector, Indices=10, Wrap=True)
ins_22 = InsertItems(List=ins_21, Item=vec_12.Vector, Indices=11, Wrap=True)

bbox = BoundingBox(Content=hull, Plane=PlaneXY(0, 0, 0))  # -> Box, Box_2
box_corners = BoxCorners(Box=bbox.Box)  # -> CornerA, CornerB, CornerC, CornerD, CornerE, CornerF, CornerG, CornerH
draft = Slider(0.79, range=0..1)
dwl = _4PointSurface(CornerA=box_corners.CornerA, CornerB=box_corners.CornerB, CornerC=box_corners.CornerC, CornerD=box_corners.CornerD)
vec_14 = VectorXYZ(XComponent=0, YComponent=0, ZComponent=draft)  # -> Vector, Length
move = Move(Geometry=dwl, Motion=vec_14.Vector)  # -> Geometry, Transform
sec = BrepPlane(Brep=hull, Plane=move.Geometry)  # -> Curves, Points
srfsplit = SurfaceSplit(Surface=hull, Curves=sec.Curves)
item_12 = ListItem(List=srfsplit, Index=1, Wrap=True)
item_13 = ListItem(List=srfsplit, Index=0, Wrap=True)
srf4pt = _4PointSurface(CornerA=box_corners.CornerD, CornerB=box_corners.CornerA, CornerC=box_corners.CornerE, CornerD=box_corners.CornerH)
sint = SolidIntersection(BrepsA=item_12, BrepsB=move.Geometry)
mirror = Mirror(Geometry=item_13, Plane=Plane(origin=(0, 0, 0), x=(0, 0, 1), y=(1, 0, 0)))  # -> Geometry, Transform
brep = Brep(srf4pt)
mirror_2 = Mirror(Geometry=sint, Plane=Plane(origin=(0, 0, 0), x=(0, 0, 1), y=(1, 0, 0)))  # -> Geometry, Transform
mirror_3 = Mirror(Geometry=srf4pt, Plane=Plane(origin=(0, 0, 0), x=(0, 0, 1), y=(1, 0, 0)))  # -> Geometry, Transform
mirror_4 = Mirror(Geometry=item_12, Plane=Plane(origin=(0, 0, 0), x=(0, 0, 1), y=(1, 0, 0)))  # -> Geometry, Transform
brep_2 = Brep(sint)
ins_23 = InsertItems(List=brep_2, Item=mirror_2.Geometry, Indices=1, Wrap=True)
ins_24 = InsertItems(List=brep, Item=mirror_3.Geometry, Indices=1, Wrap=True)
srf = Surface(item_12)
join = BrepJoin(Breps=ins_23)  # -> Breps, Closed
ins_25 = InsertItems(List=srf, Item=mirror_4.Geometry, Indices=1, Wrap=True)
sint_2 = SolidIntersection(BrepsA=ins_24, BrepsB=join.Breps)
join_2 = BrepJoin(Breps=ins_25)  # -> Breps, Closed

pdeform = PointDeform(Geometry=hull, Points=ins_10, Motion=ins_21)

submerged_volume = Volume(Geometry=sint_2)  # -> Volume, Centroid; disabled
wetted_surface = Area(Geometry=join_2.Breps)  # -> Area, Centroid; disabled
tag = TextTag3D(Location=Plane(origin=(18, 7, 0), x=(-1, 0, 0), y=(0, -1, 0)), Text=submerged_volume.Volume, Size=1, Justification=7)  # disabled
tag_2 = TextTag3D(
    Location=Plane(origin=(23, 7, 0), x=(-1, 0, 0), y=(0, -1, 0)),
    Text="Volume",
    Size=1,
    Colour=RGB(5, 0, 0),
    Justification=7)  # disabled
tag_3 = TextTag3D(Location=Plane(origin=(18, 5, 0), x=(-1, 0, 0), y=(0, -1, 0)), Text=wetted_surface.Area, Size=1, Justification=7)  # disabled
tag_4 = TextTag3D(
    Location=Plane(origin=(28, 5, 0), x=(-1, 0, 0), y=(0, -1, 0)),
    Text="Wetted Surface",
    Size=1,
    Colour=RGB(0, 0, 0),
    Justification=7)  # disabled
tag_5 = TextTag3D(Location=Plane(origin=(18, 5, 0), x=(-1, 0, 0), y=(0, -1, 0)), Size=1, Justification=7)  # disabled

sec_2 = BrepPlane(Brep=pdeform, Plane=move.Geometry)  # -> Curves, Points
srfsplit_2 = SurfaceSplit(Surface=hull, Curves=sec_2.Curves)
item_14 = ListItem(List=srfsplit_2, Index=1, Wrap=True)
item_15 = ListItem(List=srfsplit_2, Index=0, Wrap=True)
srf4pt_2 = _4PointSurface(CornerA=box_corners.CornerD, CornerB=box_corners.CornerA, CornerC=box_corners.CornerE, CornerD=box_corners.CornerH)
sint_3 = SolidIntersection(BrepsA=item_14, BrepsB=move.Geometry)
mirror_5 = Mirror(Geometry=item_15, Plane=Plane(origin=(0, 0, 0), x=(0, 0, 1), y=(1, 0, 0)))  # -> Geometry, Transform
brep_3 = Brep(srf4pt_2)
mirror_6 = Mirror(Geometry=sint_3, Plane=Plane(origin=(0, 0, 0), x=(0, 0, 1), y=(1, 0, 0)))  # -> Geometry, Transform
mirror_7 = Mirror(Geometry=srf4pt_2, Plane=Plane(origin=(0, 0, 0), x=(0, 0, 1), y=(1, 0, 0)))  # -> Geometry, Transform
mirror_8 = Mirror(Geometry=item_14, Plane=Plane(origin=(0, 0, 0), x=(0, 0, 1), y=(1, 0, 0)))  # -> Geometry, Transform
brep_4 = Brep(sint_3)
ins_26 = InsertItems(List=brep_4, Item=mirror_6.Geometry, Indices=1, Wrap=True)
ins_27 = InsertItems(List=brep_3, Item=mirror_7.Geometry, Indices=1, Wrap=True)
srf_2 = Surface(item_14)
join_3 = BrepJoin(Breps=ins_26)  # -> Breps, Closed
ins_28 = InsertItems(List=srf_2, Item=mirror_8.Geometry, Indices=1, Wrap=True)
sint_4 = SolidIntersection(BrepsA=ins_27, BrepsB=join_3.Breps)
join_4 = BrepJoin(Breps=ins_28)  # -> Breps, Closed

submerged_volume_2 = Volume(Geometry=sint_4)  # -> Volume, Centroid
wetted_surface_2 = Area(Geometry=join_4.Breps)  # -> Area, Centroid
tag_6 = TextTag3D(Location=Plane(origin=(18, 7, 0), x=(-1, 0, 0), y=(0, -1, 0)), Text=submerged_volume_2.Volume, Size=1, Justification=7)
tag_7 = TextTag3D(
    Location=Plane(origin=(23, 7, 0), x=(-1, 0, 0), y=(0, -1, 0)),
    Text="Volume",
    Size=1,
    Colour=RGB(5, 0, 0),
    Justification=7)
tag_8 = TextTag3D(Location=Plane(origin=(18, 5, 0), x=(-1, 0, 0), y=(0, -1, 0)), Text=wetted_surface_2.Area, Size=1, Justification=7)
tag_9 = TextTag3D(
    Location=Plane(origin=(28, 5, 0), x=(-1, 0, 0), y=(0, -1, 0)),
    Text="Wetted Surface",
    Size=1,
    Colour=RGB(0, 0, 0),
    Justification=7)
tag_10 = TextTag3D(Location=Plane(origin=(18, 5, 0), x=(-1, 0, 0), y=(0, -1, 0)), Size=1, Justification=7)

galapagos = Galapagos(
    fitness=wetted_surface_2,
    gene=[number_slider, number_slider_2, number_slider_3, number_slider_4, number_slider_5, number_slider_6, number_slider_7, number_slider_8, number_slider_9, number_slider_10, number_slider_11, number_slider_12, number_slider_13, number_slider_14, number_slider_15, number_slider_16, number_slider_17, number_slider_18, number_slider_19, number_slider_20, number_slider_21, number_slider_22, number_slider_23, number_slider_24])
goat = Goat(
    fitness=wetted_surface_2,
    gene=[number_slider, number_slider_2, number_slider_3, number_slider_4, number_slider_5, number_slider_6, number_slider_7, number_slider_8, number_slider_9, number_slider_10, number_slider_11, number_slider_12, number_slider_13, number_slider_14, number_slider_15, number_slider_16, number_slider_17, number_slider_18, number_slider_19, number_slider_20, number_slider_21, number_slider_22, number_slider_23, number_slider_24])
octopus = Octopus()
